# Grasshopper definition GHto3JSJSON-181009.gh (Grasshopper 1.0.7)
# plug-ins: LunchBox

platoocta = PlatonicOctahedron(Plane=PlaneXY(0, 0, 0), Radius=10, Truncation=0)
Z = UnitZ(Factor=Slider(21, range=0..100))
platotetra = PlatonicTetrahedron(Plane=PlaneXY(0, 0, 0), Radius=10, Truncation=0)
move = Move(Geometry=platoocta, Motion=Z)  # -> Geometry, Transform
merge = Merge(Data1=move.Geometry, Data2=platotetra)
tri = Triangulate(Mesh=merge)  # -> Mesh, Count
tri_2 = Triangulate(Mesh=merge)  # -> Mesh, Count

# ----
# GRASSHOPPER TO MESH VERTICES + FACES
# 0 for triangular faces
# 3 for cube
# INPUT MESH GEOMETRY
demesh = DeconstructMesh(Mesh=tri.Mesh)  # -> Vertices, Faces, Colours, Normals
pt2num = PointsToNumbers(Points=demesh.Vertices, Mask=4)
int = Integer(0)
int_2 = Integer(0)
deface = DeconstructFace(Face=demesh.Faces)  # -> graft(CornerA), graft(CornerB), graft(CornerC), graft(CornerD)
join = TextJoin(Text=pt2num, Join=",")
long = LongestList(ListC=int, ListA=int_2, ListB=deface.CornerA, PaddingMode=2)  # -> ListC, ListA, ListB
merge_2 = Merge(Data1=long.ListC, Data2=deface.CornerA, Data3=deface.CornerB, Data4=deface.CornerC)
join_2 = TextJoin(Text=merge_2, Join=",")  # -> flatten(Result)
join_3 = TextJoin(Text=join_2, Join=",")  # -> flatten(Result)

# ----
# GRASSHOPPER TO MESH VERTICES + FACES
# 0 for triangular faces
# 3 for cube
# INPUT MESH GEOMETRY
demesh_2 = DeconstructMesh(Mesh=tri_2.Mesh)  # -> simplify(Vertices), simplify(Faces), simplify(Colours), simplify(Normals)
pt2num_2 = PointsToNumbers(Points=demesh_2.Vertices, Mask=4)
int_3 = Integer(0)
int_4 = Integer(0)
deface_2 = DeconstructFace(Face=demesh_2.Faces)  # -> graft(CornerA), graft(CornerB), graft(CornerC), graft(CornerD)
join_4 = TextJoin(Text=pt2num_2, Join=",")  # -> simplify(Result)
long_2 = LongestList(ListC=int_3, ListA=int_4, ListB=deface_2.CornerA, PaddingMode=2)  # -> ListC, ListA, ListB
merge_3 = Merge(Data1=long_2.ListC, Data2=deface_2.CornerA, Data3=deface_2.CornerB, Data4=deface_2.CornerC)
join_5 = TextJoin(Text=merge_3, Join=",")
join_6 = TextJoin(Text=join_5, Join=",")

range = Range(Domain=Domain(0, 1), Steps=10)
gradient = Gradient(LowerLimit=0, UpperLimit=1, Parameter=range, stops=[0: RGB(255, 255, 255), 1: RGB(39, 227, 152)])
panel = Panel(deface.CornerA)
panel_2 = Panel(deface_2.CornerA)
panel_3 = Panel(long_2.ListC)
conmesh = ConstructMesh(Vertices=demesh_2.Vertices, Faces=demesh_2.Faces, Colours=gradient)
toggle = BooleanToggle(True)
demesh_3 = DeconstructMesh(Mesh=conmesh)  # -> Vertices, Faces, Colours, Normals
trim = TrimTree(Tree=join_6, Depth=1)
pt2num_3 = PointsToNumbers(Points=demesh_3.Vertices, Mask=4)
join_7 = TextJoin(Text=trim, Join=",")
clean = CleanTree(RemoveNulls=toggle, RemoveInvalid=toggle, RemoveEmpty=toggle, Tree=demesh_3.Colours)
deface_3 = DeconstructFace(Face=demesh_3.Faces)  # -> graft(CornerA), graft(CornerB), graft(CornerC), CornerD
panel_5 = Panel(deface_2.CornerB)
join_8 = TextJoin(Text=pt2num_3, Join=",")  # -> simplify(Result)

panel_6 = Panel(join_3)
panel_7 = Panel("Faces")

panel_8 = Panel(join)
panel_9 = Panel("Vertices")

panel_10 = Panel(join_6)

panel_12 = Panel(join_4)

merge_4 = Merge(Data1=deface_3.CornerA, Data2=deface_3.CornerB, Data3=deface_3.CornerC)
panel_14 = Panel(deface_2.CornerC)
panel_15 = Panel(join_7)
item = ListItem(List=clean, Index=merge_4, Wrap=True)  # -> simplify(Item)
trim_2 = TrimTree(Tree=item, Depth=1)
panel_16 = Panel(item)
panel_17 = Panel(merge_3)
join_9 = TextJoin(Text=trim_2, Join=",")
stringtoarray = GhPythonScript(x=join_7)  # -> a, b, c, d
# ---------- stringtoarray: Python ----------
__author__ = "s-eleung"
__version__ = "2018.10.09"

import rhinoscriptsyntax as rs
import array

input = x

print(input)

input = input.split(',')

a = [int(i) for i in input]

b = ','.join(str(x) for x in a)

c = str(array.array('B', a))

d = '[{}]'.format(b).strip()

print type(d)
print type(x)
# ---------- end stringtoarray ----------
panel_19 = Panel(join_9)
stringtoarray_2 = GhPythonScript(x=join_9)  # -> a, b, c, d
# ---------- stringtoarray_2: Python ----------
__author__ = "s-eleung"
__version__ = "2018.10.09"

import rhinoscriptsyntax as rs
import array

input = x

print(input)

input = input.split(',')

a = [int(i) for i in input]

b = ','.join(str(x) for x in a)

c = str(array.array('B', a))

d = '[{}]'.format(b).strip()
# ---------- end stringtoarray_2 ----------
panel_20 = Panel(stringtoarray.c)
panel_21 = Panel(stringtoarray.d)
stringtoarray_3 = GhPythonScript(x=join_4)  # -> d
# ---------- stringtoarray_3: Python ----------
__author__ = "s-eleung"
__version__ = "2018.10.09"

import rhinoscriptsyntax as rs
import array

input = x

print(input)

input = input.split(',')

#a = [int(i) for i in input]
#
b = ','.join(str(x) for x in input)
#
#c = str(array.array('B', a))

d = '[{}]'.format(b).strip()

a = str(input)

print b
# ---------- end stringtoarray_3 ----------
panel_22 = Panel(stringtoarray_3)
tsort = SortText(Keys="\"colours\"", Values=stringtoarray_2.d, Culture=127)  # -> Keys, Values
panel_23 = Panel(stringtoarray_2.d)
lng = ListLength(List=tri_2.Mesh)
tsort_2 = SortText(Keys="\"vertices\"", Values=stringtoarray.d, Culture=127)  # -> Keys, Values
series = Series(Start="1", Step=1, Count=lng)
concat = Concatenate(FragmentA="obj-", FragmentB=series)
panel_24 = Panel(tsort_2.Values)
panel_25 = Panel(join_8)
stringtoarray_4 = GhPythonScript(x=join_7)  # -> d; same code as stringtoarray_3
panel_26 = Panel(tsort.Values)
python = GhPythonScript(geoName=flatten(concat), vertices=flatten(stringtoarray_3), colours=flatten(stringtoarray_2.d))  # -> flatten(out), vertDict, data, outData
# ---------- python: Python ----------
__author__ = "s-eleung"
__version__ = "2018.10.09"

import rhinoscriptsyntax as rs
import json

# -------------------------------------

geoName = geoName
vertices = vertices
colours = colours

# -------------------------------------

archiJson = []



# -------------------------------------

data = []

outData = {}

outVertices = {}
outColours = {}
outGeoName = {}

outVertices['vertices'] = vertices
outColours['colours'] = colours

#data.append(outVertices)
#data.append(outColours)



#vertDict = json.dumps(outVertices)
#colDict = json.dumps(outColours)
#geoNameDict = json.dumps(outGeoName)

outData[geoName] = outVertices
outData[geoName].update(outColours)

#data.append(outGeoName)

#print json.dumps(data)

data.append(outData)

print outData
# ---------- end python ----------
python_2 = GhPythonScript(
    geoName=flatten(concat),
    vertices=flatten(stringtoarray_3),
    colours=flatten(stringtoarray_2.d),
    faces=flatten(stringtoarray_4))  # -> flatten(out), vertDict, data, outData
# ---------- python_2: Python ----------
__author__ = "s-eleung"
__version__ = "2018.10.09"

import rhinoscriptsyntax as rs
import json

# -------------------------------------

geoName = geoName
vertices = vertices
colours = colours
faces = faces

# -------------------------------------

data = []

outData = {}

outVertices = {}
outColours = {}
outGeoName = {}
outFaces = {}

outVertices['vertices'] = vertices
outColours['colours'] = colours
outGeoName['geoName'] = geoName
outFaces['faces'] = faces

data.append(outGeoName)
data.append(outVertices)
data.append(outColours)
data.append(outFaces)

outData.update(outGeoName)
outData.update(outVertices)
outData.update(outColours)
outData.update(outFaces)



vertDict = json.dumps(outVertices)
colDict = json.dumps(outColours)
#geoNameDict = json.dumps(outGeoName)

#outData[geoName] = outVertices
#outData[geoName].update(outColours)

#data.append(outGeoName)

#print json.dumps(data)

#data.append(outData)

print outData
# ---------- end python_2 ----------
panel_27 = Panel(python.data)
panel_28 = Panel(python_2.outData)
join_10 = TextJoin(Text=python.out, Join=",")
rep = ReplaceText(Text=join_10, Find="'", Replace="\"", RecursiveReplace=False)
join_11 = TextJoin(Text=python_2.out, Join=",")
item_2 = ListItem(List=flatten(panel_25), Index=1, Wrap=True)
rep_2 = ReplaceText(Text=join_11, Find="'", Replace="\"", RecursiveReplace=False)
stringtoarray_5 = GhPythonScript(x=rep)  # -> d
# ---------- stringtoarray_5: Python ----------
__author__ = "s-eleung"
__version__ = "2018.10.09"

import rhinoscriptsyntax as rs
import array

input = x

print(input)

#input = input.split(',')

#a = [int(i) for i in input]
#
#b = ','.join(str(x) for x in a)
#
#c = str(array.array('B', a))
#
d = '[{}]'.format(input).strip()

print d
# ---------- end stringtoarray_5 ----------
panel_29 = Panel(python.out)
panel_30 = Panel(stringtoarray_5)
stringtoarray_6 = GhPythonScript(x=rep_2)  # -> d; same code as stringtoarray_5
panel_31 = Panel(python_2.out)
split = TextSplit(Text=item_2, Separators=",")
panel_32 = Panel(stringtoarray_6)
split_2 = TextSplit(Text="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", Separators=",")
panel_33 = Panel(split_2)
panel_34 = Panel(split)
