# Grasshopper definition GHto3JSJSON.gh (Grasshopper 1.0.5)
# plug-ins: LunchBox

# GRASSHOPPER TO THREE.JS JSON
# THREE.JS JSON TO GRASSHOPPER
number_slider = Slider(3, range=0..10)
platoocta = PlatonicOctahedron(Plane=PlaneXY(0, 0, 0), Radius=number_slider, Truncation=0)
Z = UnitZ(Factor=number_slider)
move = Move(Geometry=platoocta, Motion=Z)  # -> Geometry, Transform
gh_to_redback = GHToRedback(object_name="Octahedron", mesh=move.Geometry)
panel = Panel(gh_to_redback)

# ==== cluster GHToRedback
mesh = ClusterInput()
object_name = ClusterInput()
gh_to_3js_faces_vertices = GHTo3JSFacesVertices(M=mesh)  # -> R_2, R
gh_to_3js_json = GHTo3JSJSON(txt=object_name, B=gh_to_3js_faces_vertices.R_2, B_2=gh_to_3js_faces_vertices.R)
_3js_json = ClusterOutput(gh_to_3js_json)

# ==== cluster GHTo3JSFacesVertices
M = ClusterInput()
tri = Triangulate(Mesh=M)  # -> Mesh, Count

# ----
# GRASSHOPPER TO MESH VERTICES + FACES
# 0 for triangular faces
# 3 for cube
# INPUT MESH GEOMETRY
demesh = DeconstructMesh(Mesh=tri.Mesh)  # -> Vertices, Faces, Colours, Normals
pt2num = PointsToNumbers(Points=demesh.Vertices, Mask=4)
int = Integer(0)
int_2 = Integer(0)
deface = DeconstructFace(Face=demesh.Faces)  # -> graft(CornerA), graft(CornerB), graft(CornerC), graft(CornerD)
join = TextJoin(Text=pt2num, Join=",")
long = LongestList(ListC=int, ListA=int_2, ListB=deface.CornerA, PaddingMode=2)  # -> ListC, ListA, ListB
merge = Merge(Data1=long.ListC, Data2=deface.CornerA, Data3=deface.CornerB, Data4=deface.CornerC)
join_2 = TextJoin(Text=merge, Join=",")  # -> flatten(Result)
join_3 = TextJoin(Text=join_2, Join=",")  # -> flatten(Result)

R = ClusterOutput(join)
panel = Panel(deface.CornerA)
R_2 = ClusterOutput(join_3)

panel_2 = Panel(join_3)
panel_3 = Panel("Faces")

panel_4 = Panel(join)
panel_5 = Panel("Vertices")

# ==== cluster GHTo3JSJSON
txt = ClusterInput()
txt_2 = Text(txt)
B = ClusterInput()
B_2 = ClusterInput()

python = GhPythonScript()  # -> out, a
# ---------- python: Python ----------
__author__ = "s-eleung"
__version__ = "2018.07.03"

import rhinoscriptsyntax as rs
import uuid

print uuid.uuid1()
# ---------- end python ----------
case = TextCase(Text=python.out, Culture=127)  # -> UpperCase, LowerCase
toggle = BooleanToggle(True)
panel = Panel(case.UpperCase)
cud = CreateCustomUserData(
    DepthWrite=toggle,
    DepthTest=toggle,
    Name="Material",
    VertexColors="0",
    Shininess="50",
    Uuid=case.UpperCase,
    Type="MeshPhongMaterial",
    Color="10724259",
    Emissive="0",
    Specular="8355711",
    Blending="1")

cud_2 = CreateCustomUserData(type="Object", generator="io_three", version="4.4")

array_maker = ARRAYMAKER(B=B)
array_maker_2 = ARRAYMAKER(B=B_2)
group_array_maker = GROUPARRAYMAKER(D=cud)

python_2 = GhPythonScript()  # -> out, a; same code as python
case_2 = TextCase(Text=python_2.out, Culture=127)  # -> UpperCase, LowerCase
panel_2 = Panel(case_2.UpperCase)
cud_3 = CreateCustomUserData(faces=array_maker, vertices=array_maker_2)
cud_4 = CreateCustomUserData(uuid=case_2.UpperCase, type="Geometry", name=txt_2, data=cud_3)

python_3 = GhPythonScript()  # -> out, a; same code as python
toggle_2 = BooleanToggle(True)
python_4 = GhPythonScript()  # -> out, a; same code as python

case_3 = TextCase(Text=python_3.out, Culture=127)  # -> UpperCase, LowerCase
case_4 = TextCase(Text=python_4.out, Culture=127)  # -> UpperCase, LowerCase
group_array_maker_2 = GROUPARRAYMAKER(D=cud_4)

panel_3 = Panel(case_3.UpperCase)
panel_4 = Panel(case_4.UpperCase)
cud_5 = CreateCustomUserData(
    Name=txt_2,
    Uuid=case_3.UpperCase,
    Matrix="[[-1, 0, 0, 0, 0, 0, 1, 0, 0, 1, 0, 0, 0, 0, 0, 1]]",
    Visible=toggle_2,
    Type="Mesh",
    Material=case.UpperCase,
    CastShadow=toggle_2,
    ReceiveShadow=toggle_2,
    Geometry=case_2.UpperCase)

group_array_maker_3 = GROUPARRAYMAKER(D=cud_5)

cud_6 = CreateCustomUserData(
    Uuid=case_4.UpperCase,
    Type="Scene",
    Matrix="[[1, 0, 0, 0, 0, 1, 0, 0, 0, 0, 1, 0, 0, 0, 0, 1]]",
    Children=group_array_maker_3)

cud_7 = CreateCustomUserData(metadata=cud_2, geometries=group_array_maker_2, materials=group_array_maker, object=cud_6)
jud = UserDataToJSON(UserData=cud_7, FormatData=1)

split = TextSplit(Text=jud, Separators="\")
join = TextJoin(Text=split)
panel_5 = Panel(jud)
panel_6 = Panel(join)

python_5 = GhPythonScript(x=join, y="\"[")  # -> out, a
# ---------- python_5: Python ----------
__author__ = "s-eleung"
__version__ = "2018.07.11"

import rhinoscriptsyntax as rs
import re

input = x
getridof = y

print input.replace(getridof, "")
# ---------- end python_5 ----------
python_6 = GhPythonScript(x=python_5.out, y="]\"")  # -> out, a; same code as python_5
chars = Characters(Text=python_6.out)  # -> Result, Unicode
cull_i = CullIndex(List=chars.Result, Indices="-1", Wrap=True)
cull_i_2 = CullIndex(List=cull_i, Indices="0", Wrap=True)
join_2 = TextJoin(Text=cull_i_2)
trim = TextTrim(Text=join_2, Start=True, End=True)
join_3 = TextJoin(Text=trim)
frmjson = FromJSON(JSON=join_3)

jo = ClusterOutput(frmjson)

# ==== cluster ARRAYMAKER
B = ClusterInput()
concat = Concatenate(FragmentA="[[", FragmentB=B)
concat_2 = Concatenate(FragmentA=concat, FragmentB="]]")
R = ClusterOutput(concat_2)

# ==== cluster GROUPARRAYMAKER
D = ClusterInput()
jud = UserDataToJSON(UserData=D, FormatData=0)
chars = Characters(Text=jud)  # -> Result, Unicode
cull_i = CullIndex(List=chars.Result, Indices="-1", Wrap=True)
cull_i_2 = CullIndex(List=cull_i, Indices="0", Wrap=True)
join = TextJoin(Text=cull_i_2)
concat = Concatenate(FragmentA="[[", FragmentB=join)
concat_2 = Concatenate(FragmentA=concat, FragmentB="]]")
R = ClusterOutput(concat_2)
