# Grasshopper definition sketch-01.gh (Grasshopper 1.0.7)
# plug-ins: Weaverbird

geo = Geometry(<brep referenced from the Rhino model>)
cap = CapHoles(Brep=geo)
mesh = MeshBrep(
    Brep=cap,
    Settings={GridMaxCount=0, GridMinCount=16, JaggedSeams=False, MaxEdgeLength=0, MinEdgeLength=0.0001, MinTolerance=0, Refine=True, RefineAngle=0, RelativeTolerance=0.65, SimplePlanes=True, Tolerance=0})
tri = Triangulate(Mesh=mesh)  # -> Mesh, Count

panel = Panel("Vertices")
panel_2 = Panel("-1,-1,-1,-1,1,-1,1,1,-1,1,-1,-1,-1,-1,1,-1,1,1,1,1,1,1,-1,1")

panel_3 = Panel("Faces")
panel_4 = Panel("3,0,1,2,3,0,3,4,7,6,5,0,3,0,4,5,1,0,3,1,5,6,2,0,3,2,6,7,3,0,3,4,0,3,7,0")

box = CenterBox(Base=PlaneXY(0, 0, 0), X=1, Y=1, Z=1)
mesh_2 = Mesh(box)

# ----
# INPUT MESH GEOMETRY
wbicosahedron = WeaverbirdsMeshMeshIcosahedron(Plane=PlaneXY(0, 0, 0), Radius=5)

# ----
# THREE.JS JSON TO GRASSHOPPER
panel_5 = Panel(",")
split = TextSplit(Text=panel_2, Separators=panel_5)
split_2 = TextSplit(Text=panel_4, Separators=panel_5)
partition = PartitionList(List=split, Size=Slider(3, range=1..50))
panel_6 = Panel(split)
partition_2 = PartitionList(List=split_2, Size=Slider(6, range=0..10))
panel_7 = Panel("""0
-1""")
cull_i = CullIndex(List=partition_2, Indices=panel_7, Wrap=True)
panel_8 = Panel(partition)
pt2num = NumbersToPoints(Numbers=flatten(partition), Mask=4)
item = ListItem(List=cull_i, Index=0, Wrap=True)  # -> Item, Item1, Item2, Item3
points = PointList(Points=pt2num)
quad = MeshQuad(CornerA=item.Item, CornerB=item.Item1, CornerC=item.Item2, CornerD=item.Item3)  # -> flatten(Face)
panel_9 = Panel(pt2num)
conmesh = ConstructMesh(Vertices=pt2num, Faces=quad)

mesh_3 = Mesh(<mesh referenced from the Rhino model>)

# ----
# MESH FROM GRASSHOPPER TO THREE.JS JSON
# 0 for triangular faces
# 3 for cube
demesh = DeconstructMesh(Mesh=mesh_3)  # -> Vertices, Faces, Colours, Normals
pt2num_2 = PointsToNumbers(Points=demesh.Vertices, Mask=4)
int = Integer(0)
int_2 = Integer(0)
deface = DeconstructFace(Face=demesh.Faces)  # -> graft(CornerA), graft(CornerB), graft(CornerC), graft(CornerD)
join = TextJoin(Text=pt2num_2, Join=",")
long = LongestList(ListC=int, ListA=int_2, ListB=deface.CornerA, PaddingMode=2)  # -> ListC, ListA, ListB
merge = Merge(Data1=long.ListC, Data2=deface.CornerA, Data3=deface.CornerB, Data4=deface.CornerC)
join_2 = TextJoin(Text=merge, Join=",")  # -> flatten(Result)
join_3 = TextJoin(Text=join_2, Join=",")  # -> flatten(Result)

join_4 = TextJoin(Text=pt2num, Join=",")

panel_10 = Panel(join_3)

panel_12 = Panel(join)

demesh_2 = DeconstructMesh(Mesh=conmesh)  # -> Vertices, Faces, Colours, Normals
pt2num_3 = PointsToNumbers(Points=demesh_2.Vertices, Mask=4)
int_3 = Integer(3)
int_4 = Integer(0)
deface_2 = DeconstructFace(Face=demesh_2.Faces)  # -> graft(CornerA), graft(CornerB), graft(CornerC), graft(CornerD)
int_5 = Integer(pt2num_3)
join_5 = TextJoin(Text=int_5, Join=",")
long_2 = LongestList(ListC=int_3, ListA=int_4, ListB=deface_2.CornerA, PaddingMode=2)  # -> ListC, ListA, ListB
merge_2 = Merge(
    Data1=long_2.ListC,
    Data2=deface_2.CornerA,
    Data3=deface_2.CornerB,
    Data4=deface_2.CornerC,
    Data5=deface_2.CornerD,
    Data6=long_2.ListA)
join_6 = TextJoin(Text=merge_2, Join=",")  # -> flatten(Result)
join_7 = TextJoin(Text=join_6, Join=",")  # -> flatten(Result)

panel_14 = Panel(join_4)

panel_15 = Panel(join_7)

panel_17 = Panel(join_5)
