# Grasshopper definition 1_SingleHTML.gh (Grasshopper 0.9.76)
# plug-ins: Python Interpreter, Human, LunchBox, Wind, FlockGH

viewports = ViewportProperties(Update=True, AutoUpdate=False)  # -> ViewportNames, ActiveViewportIndex, ViewportBounds, ViewportDisplayMode, CameraLocation, CameraTarget, CameraPlane, CameraLensLength, CameraProjection, CameraUp
box = CenterBox(Base=PlaneXY(0, 0, 0), X=Slider(3, range=0..10), Y=Slider(2, range=0..10), Z=Slider(2, range=0..10))
panel = Panel(viewports.CameraLocation)
panel_2 = Panel(viewports.CameraTarget)
panel_3 = Panel(viewports.CameraLensLength)
panel_4 = Panel(viewports.ViewportNames)
item = ListItem(List=viewports.CameraTarget, Index=0, Wrap=True)
smesh = SimpleMesh(Brep=box)
platoocta = PlatonicOctahedron(Plane=item, Radius=Slider(1, range=0..1), Truncation=0)
mesh = Mesh(smesh)
panel_5 = Panel(viewports.ViewportBounds)
preview = CustomPreview(Geometry=mesh, Shader=ColourSwatch(SwatchColor=RGB(89, 89, 89)))
merge = Merge(Data1=simplify(mesh), Data2=simplify(platoocta))  # -> flatten(Result)
item_2 = ListItem(List=viewports.ViewportBounds, Index=0, Wrap=True)
item_3 = ListItem(List=viewports.CameraLocation, Index=0, Wrap=True)
item_4 = ListItem(List=viewports.CameraTarget, Index=0, Wrap=True)
item_5 = ListItem(List=viewports.CameraLensLength, Index=0, Wrap=True)
mjoin = MeshJoin(Meshes=merge)
camera_target = Panel(item_4)
camera_position = Panel(item_3)
lens_length = Panel(item_5)
width_height = Panel(item_2)
split = TextSplit(Text=item_2, Separators="(),=")
set_mesh = SetMesh(Mesh=mjoin, Plane=PlaneXY(0, 0, 0), Shader="Grasshopper.Kernel.Types.GH_ObjectWrapper")
trim = TextTrim(Text=split, Start=True, End=True)  # -> flatten(Result)
_3js = BuildTHREEJs(Mesh=set_mesh)
panel_6 = Panel(trim)
panel_7 = Panel(_3js)
strnum = Ladybug_SeparateData(inputList=flatten(trim))  # -> numbers, strings; plug-in component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
panel_8 = Panel("""{
}""")
panel_9 = Panel("""{
}""")
split_2 = TextSplit(Text=camera_position, Separators=",")
split_3 = TextSplit(Text=item_4, Separators=",")
rep = ReplaceText(Text=split_2, Find=panel_8, Replace=" ", RecursiveReplace=False)  # -> graft(Result)
rep_2 = ReplaceText(Text=split_3, Find=panel_9, Replace=" ", RecursiveReplace=False)
join = TextJoin(Text=rep, Join=",")
bang = ExplodeTree(Data=strnum.numbers)  # -> Branch0, Branch1
panel_10 = Panel(strnum.numbers)
join_2 = TextJoin(Text=rep_2, Join=",")
bang_2 = ExplodeTree(Data=rep)  # -> _0000, _0001, _0002
division = Division(A=bang.Branch0, B=bang.Branch1)
panel_11 = Panel(join_2)
panel_12 = Panel(rep)
python = PythonScript(aspectRatio=division)  # -> out, a
# ---------- python: Python ----------
aspectRatio = aspectRatio

print aspectRatio
# ---------- end python ----------
python_2 = PythonScript(CamTarget=join_2, x=bang_2._0000, y=bang_2._0001, z=bang_2._0002)  # -> out, a
# ---------- python_2: Python ----------
CamTarget = CamTarget
x = x
y = y
z = z

template = """
			var camera = new THREE.PerspectiveCamera( 45, window.innerWidth/window.innerHeight, 0.1, 1000 );
			camera.position.x = ({0});
			camera.position.y = ({1});
			camera.position.z = ({2});
""".format(x, y, z)

print(template)
# ---------- end python_2 ----------
python_3 = PythonScript(mesh=_3js)  # -> out, a; disabled
# ---------- python_3: Python ----------
mesh = mesh

f = open('C:\Users\Emily\Desktop\project_pineapple\helloworld.html','w')

template = """<!doctype html>
<html>
  <head>
    <script src="https://cdnjs.cloudflare.com/ajax/libs/three.js/98/three.min.js"></script>
    <script src="https://cdn.rawgit.com/mrdoob/three.js/master/examples/js/controls/OrbitControls.js"></script>
    <style>
      body {
        margin: 0;
        overflow: hidden;
      }
    </style>
  </head>
  <body>

    <script>

			var scene = new THREE.Scene();
			var camera = new THREE.PerspectiveCamera( 75, window.innerWidth/window.innerHeight, 0.1, 1000 );

			var renderer = new THREE.WebGLRenderer();
			renderer.setSize( window.innerWidth, window.innerHeight );
			document.body.appendChild( renderer.domElement );
			
			var controls = new THREE.OrbitControls(camera, renderer.domElement);
			
			%s
			
			camera.position.z = 5;
			camera.position.y = 2;
			camera.position.x = 5;

			camera.lookAt(new THREE.Vector3(0,0,0));

			var animate = function () {
				requestAnimationFrame( animate );

				renderer.render( scene, camera );
			};

			animate();
			
	</script>

  </body>
</html>""" %(mesh)

message = "hello world"

print(template)

f.write(template)
f.close()
# ---------- end python_3 ----------
panel_14 = Panel(python_3.out)
item_6 = ListItem(List=python_2.out, Index=0, Wrap=True)
panel_15 = Panel(python_2.out)
python_4 = PythonScript(mesh=_3js, camera=item_6, camTarget=join_2)  # -> out, a
# ---------- python_4: Python ----------
mesh = mesh
camera = camera
camTarget = camTarget

setup = """
			camera.up.set( 0, 0, 1 );
			
			var target = new THREE.Vector3(%s);
			
			camera.lookAt(target);
			
			var controls = new THREE.OrbitControls(camera, renderer.domElement);
			
			window.addEventListener( 'resize', onWindowResize, false );

			function onWindowResize(){

				camera.aspect = window.innerWidth / window.innerHeight;
				camera.updateProjectionMatrix();

				renderer.setSize( window.innerWidth, window.innerHeight );

			}
			
			var animate = function () {
				
				requestAnimationFrame( animate );
				
				renderer.render( scene, camera );
			};
            animate();
"""%(camTarget)

thing = mesh + camera + setup

#print (thing)

f = open('C:\Users\Emily\Desktop\project_pineapple\helloworld.html','w')

template = """<!doctype html>
<html>
  <head>
    <script src="https://cdnjs.cloudflare.com/ajax/libs/three.js/98/three.min.js"></script>
    <script src="https://cdn.rawgit.com/mrdoob/three.js/master/examples/js/controls/OrbitControls.js"></script>
    <style>
      body {
        margin: 0;
        overflow: hidden;
      }
    </style>
  </head>
  <body>
    <script>
      var scene = new THREE.Scene();
			var renderer = new THREE.WebGLRenderer();
			renderer.setSize( window.innerWidth, window.innerHeight );
			document.body.appendChild( renderer.domElement );
			
			%s
			
    </script>
  </body>
</html>"""%(thing)

print(template)

f.write(template)
f.close()
# ---------- end python_4 ----------
number_slider = Slider(0.361, range=0..1)  # disabled
number_slider_2 = Slider(2, range=1..3)  # disabled
platoicosa = PlatonicIcosahedron(Plane=PlaneXY(0, 0, 0), Radius=number_slider_2, Truncation=number_slider)  # disabled
panel_16 = Panel(python_4.out)
tri = Triangulate(Mesh=platoicosa)  # -> Mesh, Count; disabled
demesh = DeconstructMesh(Mesh=tri.Mesh)  # -> Vertices, Faces, Colours, Normals; disabled
pt2num = PointsToNumbers(Points=demesh.Vertices, Mask=4)  # disabled
panel_17 = Panel(demesh.Vertices)  # disabled
deface = DeconstructFace(Face=demesh.Faces)  # -> graft(CornerA), graft(CornerB), graft(CornerC), graft(CornerD); disabled
panel_18 = Panel("0")  # disabled
join_3 = TextJoin(Text=pt2num, Join=",")  # -> simplify(Result); disabled
long = LongestList(ListC=panel_18, ListA=panel_18, ListB=deface.CornerA, PaddingMode=2)  # -> ListC, ListA, ListB; disabled
merge_2 = Merge(Data1=long.ListC, Data2=deface.CornerA, Data3=deface.CornerB, Data4=deface.CornerC)  # disabled
join_4 = TextJoin(Text=merge_2, Join=",")  # disabled
join_5 = TextJoin(Text=join_4, Join=",")  # disabled
trim_2 = TrimTree(Tree=join_5, Depth=1)  # disabled
panel_19 = Panel(",")  # disabled
join_6 = TextJoin(Text=trim_2, Join=panel_19)  # disabled

stringtoarray = GhPythonScript(x=join_3)  # -> d, vertices; disabled
# ---------- stringtoarray: Python ----------
__author__ = "s-eleung"
__version__ = "2018.10.09"

import rhinoscriptsyntax as rs
import array

input = x

#print(input)

input = input.split(',')

#a = [int(i) for i in input]
#
b = ','.join(str(x) for x in input)
#
#c = str(array.array('B', a))

d = '[{}]'.format(b).strip()

vertices = "var vertices = %s" %(d)

print vertices

a = str(input)

#print b
# ---------- end stringtoarray ----------
stringtoarray_2 = GhPythonScript(x=join_6)  # -> d, faces; disabled
# ---------- stringtoarray_2: Python ----------
__author__ = "s-eleung"
__version__ = "2018.10.09"

import rhinoscriptsyntax as rs
import array

input = x

#print(input)

input = input.split(',')

#a = [int(i) for i in input]
#
b = ','.join(str(x) for x in input)
#
#c = str(array.array('B', a))

d = '[{}]'.format(b).strip()

faces = "var faces = %s" %(d)

print faces

a = str(input)

#print b
# ---------- end stringtoarray_2 ----------
panel_20 = Panel(stringtoarray.vertices)  # disabled
panel_21 = Panel(stringtoarray_2.faces)  # disabled

python_5 = PythonScript(vertices=stringtoarray.vertices, faces=stringtoarray_2.faces)  # -> out, a; disabled
# ---------- python_5: Python ----------
x = x

f = open('C:\Users\Emily\Desktop\scene.html','w')

template = """<!doctype html>
<html>
  <head>
    <script src="https://cdnjs.cloudflare.com/ajax/libs/three.js/98/three.min.js"></script>
    <script src="https://cdn.rawgit.com/mrdoob/three.js/master/examples/js/controls/OrbitControls.js"></script>
    <style>
      body {
        margin: 0;
        overflow: hidden;
      }
    </style>
  </head>
  <body>

    <script>

            var scene = new THREE.Scene();
			var camera = new THREE.PerspectiveCamera( 75, window.innerWidth/window.innerHeight, 0.1, 1000 );

			var renderer = new THREE.WebGLRenderer();
			renderer.setSize( window.innerWidth, window.innerHeight );
            document.body.appendChild( renderer.domElement );
            
            var controls = new THREE.OrbitControls(camera, renderer.domElement);
            
            %s

			var geometry = new THREE.BoxGeometry( 1, 1, 1 );
			var material = new THREE.MeshBasicMaterial( { color: 0x00ff00 } );
			var cube = new THREE.Mesh( geometry, material );
			scene.add( cube );

			camera.position.z = 5;
			camera.position.y = 2;
            camera.position.x = 5;

            camera.lookAt(new THREE.Vector3(0,0,0));

			var animate = function () {
				requestAnimationFrame( animate );

				cube.rotation.x += 0.01;
				cube.rotation.y += 0.01;

				renderer.render( scene, camera );
			};

            animate();
            
    </script>

  </body>
</html>""" %(x)

message = "hello world"

print("""%s""" %(x))

f.write(template)
f.close()
# ---------- end python_5 ----------
panel_22 = Panel(python_5.out)
