# Grasshopper definition 1_SingleHTML_181117.gh (Grasshopper 0.9.76)
# plug-ins: Python Interpreter, Human, LunchBox, Wind, FlockGH

viewports = ViewportProperties(Update=True, AutoUpdate=False)  # -> ViewportNames, ActiveViewportIndex, ViewportBounds, ViewportDisplayMode, CameraLocation, CameraTarget, CameraPlane, CameraLensLength, CameraProjection, CameraUp
box = CenterBox(Base=PlaneXY(0, 0, 0), X=Slider(2, range=0..10), Y=Slider(1, range=0..10), Z=Slider(1, range=0..10))
panel = Panel(viewports.CameraLocation)
panel_2 = Panel(viewports.CameraTarget)
panel_3 = Panel(viewports.CameraLensLength)
panel_4 = Panel(viewports.ViewportNames)
mesh = Mesh(box)
panel_5 = Panel(viewports.ViewportBounds)
set_mesh = SetMesh(Mesh=mesh, Plane=PlaneXY(0, 0, 0), Shader="Grasshopper.Kernel.Types.GH_ObjectWrapper")
_3js = BuildTHREEJs(Mesh=set_mesh)
item = ListItem(List=viewports.ViewportBounds, Index=0, Wrap=True)
item_2 = ListItem(List=viewports.CameraLocation, Index=0, Wrap=True)
item_3 = ListItem(List=viewports.CameraTarget, Index=0, Wrap=True)
item_4 = ListItem(List=viewports.CameraLensLength, Index=0, Wrap=True)
lens_length = Panel(item_4)
width_height = Panel(item)
camera_position = Panel(item_2)
camera_target = Panel(item_3)
panel_6 = Panel(_3js)
split = TextSplit(Text=item, Separators="(),")
trim = TextTrim(Text=split, Start=True, End=True)
panel_7 = Panel(trim)
python = PythonScript(mesh=_3js)  # -> out, a
# ---------- python: Python ----------
mesh = mesh

f = open('C:\Users\Emily\Desktop\project_pineapple\helloworld.html','w')

template = """<!doctype html>
<html>
  <head>
    <script src="https://cdnjs.cloudflare.com/ajax/libs/three.js/98/three.min.js"></script>
    <script src="https://cdn.rawgit.com/mrdoob/three.js/master/examples/js/controls/OrbitControls.js"></script>
    <style>
      body {
        margin: 0;
        overflow: hidden;
      }
    </style>
  </head>
  <body>

    <script>

        var scene = new THREE.Scene();
			var camera = new THREE.PerspectiveCamera( 75, window.innerWidth/window.innerHeight, 0.1, 1000 );

			var renderer = new THREE.WebGLRenderer();
			renderer.setSize( window.innerWidth, window.innerHeight );
            document.body.appendChild( renderer.domElement );
            
            var controls = new THREE.OrbitControls(camera, renderer.domElement);
            
            %s

			camera.position.z = 5;
			camera.position.y = 2;
            camera.position.x = 5;

            camera.lookAt(new THREE.Vector3(0,0,0));

			var animate = function () {
				requestAnimationFrame( animate );

				renderer.render( scene, camera );
			};

            animate();
            
    </script>

  </body>
</html>""" %(mesh)

message = "hello world"

print("""%s""" %(x))

f.write(template)
f.close()
# ---------- end python ----------
python_2 = PythonScript(fov="75")  # -> out, a
# ---------- python_2: Python ----------
fov = fov
#aspectRatio = aspectRatio
#near = near
#far = far

print fov
# ---------- end python_2 ----------
number_slider = Slider(0.361, range=0..1)  # disabled
number_slider_2 = Slider(2, range=1..3)  # disabled
platoicosa = PlatonicIcosahedron(Plane=PlaneXY(0, 0, 0), Radius=number_slider_2, Truncation=number_slider)  # disabled
tri = Triangulate(Mesh=platoicosa)  # -> Mesh, Count; disabled
demesh = DeconstructMesh(Mesh=tri.Mesh)  # -> Vertices, Faces, Colours, Normals; disabled
pt2num = PointsToNumbers(Points=demesh.Vertices, Mask=4)  # disabled
panel_8 = Panel(demesh.Vertices)  # disabled
deface = DeconstructFace(Face=demesh.Faces)  # -> graft(CornerA), graft(CornerB), graft(CornerC), graft(CornerD); disabled
panel_9 = Panel("0")  # disabled
join = TextJoin(Text=pt2num, Join=",")  # -> simplify(Result); disabled
long = LongestList(ListC=panel_9, ListA=panel_9, ListB=deface.CornerA, PaddingMode=2)  # -> ListC, ListA, ListB; disabled
merge = Merge(Data1=long.ListC, Data2=deface.CornerA, Data3=deface.CornerB, Data4=deface.CornerC)  # disabled
join_2 = TextJoin(Text=merge, Join=",")  # disabled
join_3 = TextJoin(Text=join_2, Join=",")  # disabled
trim_2 = TrimTree(Tree=join_3, Depth=1)  # disabled
panel_10 = Panel(",")  # disabled
join_4 = TextJoin(Text=trim_2, Join=panel_10)  # disabled

stringtoarray = GhPythonScript(x=join)  # -> d, vertices; disabled
# ---------- stringtoarray: Python ----------
__author__ = "s-eleung"
__version__ = "2018.10.09"

import rhinoscriptsyntax as rs
import array

input = x

#print(input)

input = input.split(',')

#a = [int(i) for i in input]
#
b = ','.join(str(x) for x in input)
#
#c = str(array.array('B', a))

d = '[{}]'.format(b).strip()

vertices = "var vertices = %s" %(d)

print vertices

a = str(input)

#print b
# ---------- end stringtoarray ----------
stringtoarray_2 = GhPythonScript(x=join_4)  # -> d, faces; disabled
# ---------- stringtoarray_2: Python ----------
__author__ = "s-eleung"
__version__ = "2018.10.09"

import rhinoscriptsyntax as rs
import array

input = x

#print(input)

input = input.split(',')

#a = [int(i) for i in input]
#
b = ','.join(str(x) for x in input)
#
#c = str(array.array('B', a))

d = '[{}]'.format(b).strip()

faces = "var faces = %s" %(d)

print faces

a = str(input)

#print b
# ---------- end stringtoarray_2 ----------
panel_11 = Panel(stringtoarray.vertices)  # disabled
panel_12 = Panel(stringtoarray_2.faces)  # disabled

python_3 = PythonScript(vertices=stringtoarray.vertices, faces=stringtoarray_2.faces)  # -> out, a; disabled
# ---------- python_3: Python ----------
x = x

f = open('C:\Users\Emily\Desktop\scene.html','w')

template = """<!doctype html>
<html>
  <head>
    <script src="https://cdnjs.cloudflare.com/ajax/libs/three.js/98/three.min.js"></script>
    <script src="https://cdn.rawgit.com/mrdoob/three.js/master/examples/js/controls/OrbitControls.js"></script>
    <style>
      body {
        margin: 0;
        overflow: hidden;
      }
    </style>
  </head>
  <body>

    <script>

            var scene = new THREE.Scene();
			var camera = new THREE.PerspectiveCamera( 75, window.innerWidth/window.innerHeight, 0.1, 1000 );

			var renderer = new THREE.WebGLRenderer();
			renderer.setSize( window.innerWidth, window.innerHeight );
            document.body.appendChild( renderer.domElement );
            
            var controls = new THREE.OrbitControls(camera, renderer.domElement);
            
            %s

			var geometry = new THREE.BoxGeometry( 1, 1, 1 );
			var material = new THREE.MeshBasicMaterial( { color: 0x00ff00 } );
			var cube = new THREE.Mesh( geometry, material );
			scene.add( cube );

			camera.position.z = 5;
			camera.position.y = 2;
            camera.position.x = 5;

            camera.lookAt(new THREE.Vector3(0,0,0));

			var animate = function () {
				requestAnimationFrame( animate );

				cube.rotation.x += 0.01;
				cube.rotation.y += 0.01;

				renderer.render( scene, camera );
			};

            animate();
            
    </script>

  </body>
</html>""" %(x)

message = "hello world"

print("""%s""" %(x))

f.write(template)
f.close()
# ---------- end python_3 ----------
panel_13 = Panel(python_3.out)
